# Grasshopper definition Template_Analyse_Karamba.gh (Grasshopper 0.9.76)
# plug-ins: Karamba, MeshEdit Components, Python Interpreter

# ----
# Paramètres
# On peut choisir d'imprimer à vitesse constante ("V constante")
# ou d'adapter la vitesse pour conserver le temps entre couches
# constant ("T constant").
vitesse_m_s = Slider(0.25, range=0..1)
rapport_largeur_épaisseur_du_cordon = Slider(4.2, range=0..10)
épaisseur_cordon_m = Slider(0.005, range=0.001..0.5)
list = ValueList({"V constante": 0, "T constante": 1}, selected="V constante")

# ---- group: Parcours d'outil
# Paul CARNEAU
# Pour le cours de Conception Avancée des Structures
# Projet de Voûte Nubienne
# Novembre 2018
# Géométrie initiale
# Sous forme de courbes uo polylignes fermées en mètres !
crv = Curve(reparameterize(reverse([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])))

# ----
# Subdivise les courbes en N points qui définissent la précision du maillage.
# Chaque "couche" est ensuite transformée en un maillage pour obtenir
# une liste de maillages ordonnées de bas en haut.
number_slider = Slider(400, range=0..1000)
divide = DivideCurve(Curve=crv, Count=number_slider, Kinks=False)  # -> flatten(Points), Tangents, Parameters
lng = ListLength(List=crv)
python = PythonScript(points=divide.Points, N=number_slider, c=lng)  # -> out, M; inputs points: list of Point3d, N: Int32, c: Int32
# ---------- python: Python ----------
import rhinoscriptsyntax as rs

M=[]
F=[]
for k in range(0,N-1):
    F.append([k,k+1,k+1+N,k+N])
F.append([0,N,2*N-1,N-1])

for i in range(0,c-1):
    P=[]
    for j in range(0,2*N):
        P.append(points[i*N+j])
    M.append(rs.AddMesh(P,F))
# ---------- end python ----------
mesh = Mesh(simplify(python.M))

# ----
# Si le script Python ne fonctionne pas, essayer le cluster...
mesh_all_layers = MeshAllLayers(crv=crv)

# ---- group: Cordons
mesh_2 = Mesh(mesh)

# ---- group: Détermine la taille minimale d'un bord du maillage
medges = MeshEdges(Mesh=mesh_2)  # -> NakedEdges, InteriorEdges, NonManifoldEdges
crv_2 = Curve(flatten([medges.InteriorEdges, medges.NakedEdges]))
len = Length(Curve=crv_2)
sort = SortList(Keys=len)  # -> Keys, ValuesA
item = ListItem(List=sort.Keys, Index=0, Wrap=True)
division = Division(A=item, B=2)

# ---- group: Supports du maillage
supports = Supports(M=mesh_2, B=Slider(0.003, range=0.001..0.02))
pt = Point(supports)
supp = SupportKaramba(PosInd=pt, menu=[buttons(on, on, on, off, off, off)])

# ---- group: Chargement
# poids propre
Z = UnitZ(Factor=1)
rev = Reverse(Vector=Z)
loads = LoadsKaramba(Vector=rev, LCase=0, mode="Gravity")

# ----
# Attention, peut être particulièrement long en temps de calcul !
number_slider_2 = Slider(1, range=0..10)

lng_2 = ListLength(List=crv)
# Cinématique d'impression
cull_i = CullIndex(List=crv, Indices=expr("x-1", lng_2), Wrap=True)
len_2 = Length(Curve=cull_i)
division_2 = Division(A=len_2, B=vitesse_m_s)
series = Series(Start="1", Step=1, Count=expr("x-1", lng_2))

# ---- group: Temps d'impression des couches
item_2 = ListItem(List=division_2, Index=0, Wrap=True)

# ----
dup = DuplicateData(Data=item_2, Number=expr("x-1", lng_2), Order=True)
filter = StreamFilter(Gate=list, Stream0=division_2, Stream1=dup)
split = SplitList(List=filter, Index=series)  # -> ListA, ListB
ma = MassAddition(Input=split.ListA)  # -> flatten(Result), PartialResults
item_3 = ListItem(List=reverse(ma.Result), Index=0, Wrap=True)

# ---- group: Vitesse de chaque couche
division_3 = Division(A=len_2, B=filter)

# ----
# Temps et durée totale d'impression
temps = Slider(50, range=0..3600)
duree_d_impression_totale = Panel(item_3)

panel = Panel(division_3)
larger = LargerThan(FirstNumber=temps, SecondNumber=ma.Result)  # -> LargerThan, OrEqualTo
subtraction = Subtraction(A=temps, B=ma.Result)
mindex = MemberIndex(Set=larger.OrEqualTo, Member=Toggle(True))  # -> Index, Count
split_2 = SplitList(List=subtraction, Index=mindex.Count)  # -> ListA, ListB

age_des_cordons = Data(split_2.ListA)

# ---- group: Activation des cordons en fonction du temps
split_3 = SplitList(List=mesh_2, Index=mindex.Count)  # -> ListA, ListB

# ----
series_2 = Series(Start=0, Step=1, Count=lng_2)
mesh_3 = Mesh(split_3.ListA)
int = Integer(series_2)
split_4 = SplitList(List=int, Index=mindex.Count)  # -> ListA, ListB
triangulate = MeshTriangulate(Mesh=mesh_3, ShortDiagonal=False)
concat = Concatenate(FragmentA="cordon", FragmentB=split_4.ListA)
meshtoshell = MeshToShellKaramba(Mesh=triangulate, Identifier=concat, LimitDistance_m=division)  # -> Element, Points, Info

# ---- group: Largeur du cordon
multiplication = Multiplication(A=rapport_largeur_épaisseur_du_cordon, B=épaisseur_cordon_m)
panel_2 = Panel("béton")
multiplication_2 = Multiplication(A=multiplication, B=100)
cross_sections = CrossSectionsKaramba(
    FamilyNameOfCrossSection=panel_2,
    ElementsIdentifiers=concat,
    Material=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,
    Height_cm=multiplication_2,
    mode="Shell - Const")  # -> flatten(CrossSection)

# ---- group: Gradient de raideur
# Ductal accéléré - G'
expression = Expression(x=age_des_cordons, Expression="-0.0004*x^3 + 0.7644*x^2 + 217.52*x + 4596.7")
nu = Slider(0.3, range=0..1)
multiplication_3 = Multiplication(A=expression, B="10^-7")
expression_2 = Expression(G=multiplication_3, nu=nu, Expression="G*(2*(1+nu))")
matprops = MaterialPropertiesKaramba(
    FamilyOfMaterial=panel_2,
    Name="S235",
    ElementsIdentifiers=graft(concat),
    YoungsModulus_kN_cm2=graft(expression_2),
    InPlaneShearModulus_kN_cm2=graft(multiplication_3),
    TransverseShearModulus_kN_cm2=8076,
    SpecificWeight_kN_m3=Slider(20, range=0..100),
    CoefficientOfThermalExpansion_1_C=1e-05,
    YieldStrength_kN_cm2=Slider(0.01, range=0..0.1),
    mode="Isotrop")  # -> flatten(Material)

# ----
assemble = AssembleModelKaramba(
    Elem=meshtoshell.Element,
    Support=supp,
    Load=loads,
    CrossSection=cross_sections,
    Material=matprops,
    LimitDistance_m=division)  # -> Model, Info, Mass_kg, CenterOfGravity
# Analyse non-linéaire
analyzethii = AnalyzeThIIKaramba(Model=assemble.Model, LoadCase=-1, RTolerance=1e-07, MaxIterations=Slider(10, range=0..100), NoTensionalNII=False)  # -> CalculatedModel, MaximumDisplacement_m, ResultingForceOfGravity_kN, ElasticEnergy_kNm; disabled
# Analyse linéaire
analyzethi = AnalyzeThIKaramba(Model=assemble.Model)  # -> CalculatedModel, MaximumDisplacement_m, ResultingForceOfGravity_kN, ElasticEnergy_kNm
bmodes = BucklingModesKaramba(
    Model=analyzethii.CalculatedModel,
    FromIndex=1,
    NumberOfModes=number_slider_2,
    MaximumNumberOfIterations=300,
    Epsilon=1e-07)  # -> ModelWithBucklingModesAsLoadCaseResults, BucklingLoadFactors
modelview = ModelViewKaramba(Model=analyzethi.CalculatedModel, LoadCaseFactorsForLinearSuperposition=1, IndexOfVisibleLoadcase=-1)  # -> Model, DeformedMesh, DeformedAxes, DeformedModel
panel_3 = Panel(bmodes.BucklingLoadFactors)
shellview = ShellViewKaramba(Model=modelview.Model, IndexOfLayer=0)  # -> Model, MeshesOfRenderedShells, LegendColors, LegendTags
legend = Legend(Colour=shellview.LegendColors, Tags=shellview.LegendTags, LegendType=1)

# ==== cluster Supports
B = ClusterInput()
M = ClusterInput()
demesh = DeconstructMesh(Mesh=M)  # -> Vertices, Faces, Colours, Normals
tstat = TreeStatistics(Tree=demesh.Vertices)  # -> Paths, Length, Count
item = ListItem(List=tstat.Paths, Index=0, Wrap=True)
branch = TreeBranch(Tree=demesh.Vertices, Path=item, MaintainPaths=True)
pdecon = Deconstruct(Point=branch)  # -> XComponent, YComponent, ZComponent
smaller = SmallerThan(FirstNumber=pdecon.ZComponent, SecondNumber=B)  # -> SmallerThan, OrEqualTo
dispatch = Dispatch(List=branch, DispatchPattern=smaller.SmallerThan)  # -> ListA, ListB
A = ClusterOutput(dispatch.ListA)

# ==== cluster MeshAllLayers
crv = ClusterInput()
crv_2 = Curve(reparameterize(crv))
bbox = BoundingBox(Content=crv_2, Plane=PlaneXY(0, 0, 0), UnionBox=True)  # -> Box, Box_2
debox = DeconstructBox(Box=bbox.Box)  # -> Plane, X, Y, Z
dedomain = DeconstructDomain(Domain=debox.X)  # -> Start, End
dedomain_2 = DeconstructDomain(Domain=debox.Z)  # -> Start, End
xz = XZPlane(Origin=Point(0, 0, 0))
number_slider = Slider(0.69, range=0..1)
multiplication = Multiplication(A=dedomain.End, B=2)
multiplication_2 = Multiplication(A=dedomain_2.End, B=2)
srf = Surface(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)
pcx = CurvePlane(Curve=crv_2, Plane=xz)  # -> Points, ParamsC, ParamsP
item = ListItem(List=pcx.ParamsC, Index=0, Wrap=True)
pt = ConstructPoint(XCoordinate=0, YCoordinate=0, ZCoordinate=dedomain_2.Start)
pt_2 = ConstructPoint(XCoordinate=0, YCoordinate=0, ZCoordinate=multiplication_2)
pt_3 = ConstructPoint(XCoordinate=multiplication, YCoordinate=0, ZCoordinate=multiplication_2)
pt_4 = ConstructPoint(XCoordinate=multiplication, YCoordinate=0, ZCoordinate=dedomain_2.Start)
item_2 = ListItem(List=pcx.Points, Index=0, Wrap=True)
srf4pt = _4PointSurface(CornerA=pt, CornerB=pt_2, CornerC=pt_3, CornerD=pt_4)
scx = SurfaceCurve(Surface=srf4pt, Curve=crv_2)  # -> Curves, Points, UVPoints, Normals, Parameters, Tangents
seam = Seam(Curve=reparameterize(crv), Seam=flatten(scx.Parameters))  # -> graft(Curve)
divide = DivideCurve(Curve=flatten(seam), Count=Slider(178, range=0..200), Kinks=Toggle(False))  # -> simplify(Points), Tangents, Parameters
pt_5 = Point(divide.Points)
sort_pt = SortPoints(Points=pt_5)  # -> Points, Indices
alongcrv = SortAlongCurve(Points=sort_pt.Points, Curve=seam)  # -> simplify(Points), Indices
panel = Panel(pcx.ParamsC)
path_mapper = PathMapper(alongcrv.Points, source="{i}", target="{i+1}")
merge = Merge(Data1=path_mapper, Data2=alongcrv.Points)
tstat = TreeStatistics(Tree=merge)  # -> Paths, Length, Count
lng = ListLength(List=tstat.Paths)  # -> expr("x-1", Length)
cull_i = CullIndex(List=tstat.Paths, Indices=["0", lng], Wrap=True)
lng_2 = ListLength(List=alongcrv.Points)  # -> flatten(Length)
branch = TreeBranch(Tree=merge, Path=cull_i, MaintainPaths=True)
item_3 = ListItem(List=lng_2, Index=0, Wrap=True)
series = Series(Start=0, Step=1, Count=item_3)
path_mapper_2 = PathMapper(branch, source="{i}", target="{i-1}")
addition = Addition(A=series, B=item_3)
shift = ShiftList(List=series, Shift=1, Wrap=True)
addition_2 = Addition(A=shift, B=item_3)
quad = MeshQuad(CornerA=series, CornerB=shift, CornerC=addition_2, CornerD=addition)
conmesh = ConstructMesh(Vertices=path_mapper_2, Faces=quad)  # -> flatten(Mesh)
refine = Refine(Mesh=conmesh, Level=1)
M = ClusterOutput(refine)
